# Grasshopper definition gofa-ik.gh (Grasshopper 1.0.8)
# plug-ins: Robot Components

X = Panel("""400
0""")
Y = Panel("""0
0""")
Z = Panel("""400
800""")
construct_point = ConstructPoint(XCoordinate=X, YCoordinate=Y, ZCoordinate=Z)
xy_plane = XYPlane(Origin=construct_point)
xy_plane_2 = XYPlane(Origin=Point(0, 0, 0))
flip_plane_x = FlipPlaneX(Plane=xy_plane)
name = Panel("g")
robot_target = RobotTarget(Name=name, Plane=flip_plane_x, Set_External_Joint_Position=False, Set_Reference_Plane=False)
robot_preset = RobotPreset(PositionPlane=xy_plane_2, Robot_Preset_Number=58)
inverse_kinematics = InverseKinematics(
    Robot=robot_preset,
    Movement=robot_target,
    Closest_Robot_Joint_Position=False,
    Output_Configuration_Data=True,
    Output_Posed_Meshes=False,
    Output_Posed_Planes=False,
    Set_Hide_Mesh=False)  # -> RobotJointPosition, ExternalJointPosition, ConfigurationData
robot_joint_position = Panel(inverse_kinematics.RobotJointPosition)
configuration_data = Panel(inverse_kinematics.ConfigurationData)
