# Grasshopper definition ik-fk.gh (Grasshopper 1.0.8)
# plug-ins: Robot Components

X = Slider(400, range=0..600)
Y = Slider(0, range=-300..300)
Z = Slider(400, range=0..800)
construct_point = ConstructPoint(XCoordinate=X, YCoordinate=Y, ZCoordinate=Z)
xy_plane = XYPlane(Origin=construct_point)
xy_plane_2 = XYPlane(Origin=Point(0, 0, 0))
flip_plane_x = FlipPlaneX(Plane=xy_plane)
name = Panel("target")
robot_target = RobotTarget(Name=name, Plane=flip_plane_x, Set_External_Joint_Position=False, Set_Reference_Plane=False)
robot_preset = RobotPreset(PositionPlane=xy_plane_2, Robot_Preset_Number=4)
inverse_kinematics = InverseKinematics(
    Robot=robot_preset,
    Movement=robot_target,
    Closest_Robot_Joint_Position=False,
    Output_Configuration_Data=True,
    Output_Posed_Meshes=False,
    Output_Posed_Planes=False,
    Set_Hide_Mesh=False)  # -> RobotJointPosition, ExternalJointPosition, ConfigurationData
robot_joint_position = Panel(inverse_kinematics.RobotJointPosition)
configuration_data = Panel(inverse_kinematics.ConfigurationData)
forward_kinematics = ForwardKinematics(
    Robot=robot_preset,
    RobotJointPosition=inverse_kinematics.RobotJointPosition,
    Hide_Posed_Meshes=False,
    Output_Posed_Meshes=False)  # -> EndPlane, ExternalAxisPlanes
