# Grasshopper definition io-sequence.gh (Grasshopper 1.0.8)
# plug-ins: Robot Components

signal = Panel("diPartReady")
signal_2 = Panel("doGripper")
signal_3 = Panel("doBlowOff")
seconds = Panel("0.5")
length = Panel("0.2")
signal_4 = Panel("doLamp")
state = Panel("1")
state_2 = Panel("1")
pulse_digital_output = PulseDigitalOutput(High=False, Length=length, Name=signal_3)
wait_for_digital_input = WaitForDigitalInput(Name=signal, State=state_2)
invert_digital_output = InvertDigitalOutput(Name=signal_4)
set_digital_output = SetDigitalOutput(Name=signal_2, State=state)
wait_time = WaitTime(InPosition=False, Duration=seconds)
rapid_generator = RAPIDGenerator(
    Actions=[wait_for_digital_input, set_digital_output, wait_time, pulse_digital_output, invert_digital_output],
    Add_loaddata=False,
    Add_tooldata=False,
    Add_wobjdata=False,
    Additional_Routines=False,
    Author=False,
    Enforce_Axis_Limits=False,
    Error_Handling=False,
    Is_System_Module=False,
    Main_Module=False,
    Module_Name=False,
    Output_loaddata=False,
    Output_tooldata=False,
    Output_wobjdata=False,
    Routine_Name=False,
    Routine_Scope=False)
rapid_module = Panel(rapid_generator)
