# Grasshopper definition linear-track.gh (Grasshopper 1.0.8)
# plug-ins: Robot Components

X = Panel("""1000
4000
7000""")
Y = Panel("1200")
Z = Panel("600")
construct_point = ConstructPoint(XCoordinate=X, YCoordinate=Y, ZCoordinate=Z)
xy_plane = XYPlane(Origin=construct_point)
flip_plane_x = FlipPlaneX(Plane=xy_plane)
start = Panel("0")
end = Panel("9900")
name = Panel("t")
robot_target = RobotTarget(Name=name, Plane=flip_plane_x, Set_External_Joint_Position=False, Set_Reference_Plane=False)
construct_domain = ConstructDomain(DomainStart=start, DomainEnd=end)
unit_x = UnitX(Factor=1)
xy_plane_2 = XYPlane(Origin=Point(0, 0, 0))
name_2 = Panel("TRACK_1")
index = Panel("0")
movement_type = MovementType({"MoveAbsJ": 0, "MoveL": 1, "MoveJ": 2, "MoveC": 3}, selected="MoveJ")
movement_type_2 = MovementType({"MoveAbsJ": 0, "MoveL": 1, "MoveJ": 2, "MoveC": 3}, selected="MoveL")
external_linear_axis = ExternalLinearAxis(
    Name=name_2,
    AttachmentPlane=xy_plane_2,
    Axis=unit_x,
    AxisLimits=construct_domain,
    Set_Axis_Logic_Number=False,
    Set_Moves_Robot=False)
speed = Speed({"v5": 5, "v10": 10, "v20": 20, "v30": 30, "v40": 40, "v50": 50, "v60": 60, "v80": 80, "v100": 100, "v150": 150, "v200": 200, "v300": 300, "v400": 400, "v500": 500, "v600": 600, "v800": 800, "v1000": 1000, "v1500": 1500, "v2000": 2000, "v2500": 2500, "v3000": 3000, "v4000": 4000, "v5000": 5000, "v6000": 6000, "v7000": 7000}, selected="v500")
zone = Zone({"z0": 0, "z1": 1, "z5": 5, "z10": 10, "z15": 15, "z20": 20, "z30": 30, "z40": 40, "z50": 50, "z60": 60, "z80": 80, "z100": 100, "z150": 150, "z200": 200, "fine": -1}, selected="fine")
list_item = ListItem(List=robot_target, Index=index, Wrap=True)
move = Move(
    Type=movement_type,
    Target=list_item,
    SpeedData=speed,
    ZoneData=zone,
    Override_Robot_Tool=False,
    Override_Work_Object=False,
    Set_Circular_Point=False,
    Set_Digital_Output=False,
    Set_Movement_Time=False)
move_2 = Move(
    Type=movement_type_2,
    Target=robot_target,
    SpeedData=speed,
    ZoneData=zone,
    Override_Robot_Tool=False,
    Override_Work_Object=False,
    Set_Circular_Point=False,
    Set_Digital_Output=False,
    Set_Movement_Time=False)
robot_preset = RobotPreset(PositionPlane=xy_plane_2, ExternalAxis=external_linear_axis, Robot_Preset_Number=18)
rapid_generator = RAPIDGenerator(
    Robot=robot_preset,
    Actions=flatten([move, move_2]),
    Add_loaddata=False,
    Add_tooldata=False,
    Add_wobjdata=False,
    Additional_Routines=False,
    Author=False,
    Enforce_Axis_Limits=False,
    Error_Handling=False,
    Is_System_Module=False,
    Main_Module=False,
    Module_Name=False,
    Output_loaddata=False,
    Output_tooldata=False,
    Output_wobjdata=False,
    Routine_Name=False,
    Routine_Scope=False)
rapid_module = Panel(rapid_generator)
