# Grasshopper definition multi-move.gh (Grasshopper 1.0.8)
# plug-ins: Robot Components

X = Panel("350")
Y = Panel("""-100
100""")
Z = Panel("400")
X_2 = Panel("650")
Y_2 = Panel("""100
-100""")
Z_2 = Panel("400")
construct_point = ConstructPoint(XCoordinate=X, YCoordinate=Y, ZCoordinate=Z)
construct_point_2 = ConstructPoint(XCoordinate=X_2, YCoordinate=Y_2, ZCoordinate=Z_2)
base_x = Panel("0")
base_x_2 = Panel("1000")
construct_point_3 = ConstructPoint(XCoordinate=base_x, YCoordinate=0, ZCoordinate=0)
construct_point_4 = ConstructPoint(XCoordinate=base_x_2, YCoordinate=0, ZCoordinate=0)
xy_plane = XYPlane(Origin=construct_point)
xy_plane_2 = XYPlane(Origin=construct_point_2)
xy_plane_3 = XYPlane(Origin=construct_point_3)
xy_plane_4 = XYPlane(Origin=construct_point_4)
flip_plane_x = FlipPlaneX(Plane=xy_plane)
flip_plane_x_2 = FlipPlaneX(Plane=xy_plane_2)
task_names = Panel("""T_ROB1
T_ROB2""")
angle_j5 = Panel("30")
name = Panel("allTasks")
angle_j5_2 = Panel("30")
angle = Panel("0")
name_2 = Panel("r1_home")
angle_2 = Panel("180")
name_3 = Panel("r2_home")
angle_3 = Panel("0")
angle_4 = Panel("0")
name_4 = Panel("r1_p")
name_5 = Panel("r2_p")
movement_type = MovementType({"MoveAbsJ": 0, "MoveL": 1, "MoveJ": 2, "MoveC": 3}, selected="MoveAbsJ")
movement_type_2 = MovementType({"MoveAbsJ": 0, "MoveL": 1, "MoveJ": 2, "MoveC": 3}, selected="MoveL")
movement_type_3 = MovementType({"MoveAbsJ": 0, "MoveL": 1, "MoveJ": 2, "MoveC": 3}, selected="MoveAbsJ")
robot_joint_position = RobotJointPosition(
    Name=name_2,
    RobotJointPosition1=angle_3,
    RobotJointPosition2=angle_3,
    RobotJointPosition3=angle_3,
    RobotJointPosition4=angle_3,
    RobotJointPosition5=angle_j5,
    RobotJointPosition6=angle_3)
robot_joint_position_2 = RobotJointPosition(
    Name=name_3,
    RobotJointPosition1=angle_4,
    RobotJointPosition2=angle_4,
    RobotJointPosition3=angle_4,
    RobotJointPosition4=angle_4,
    RobotJointPosition5=angle_j5_2,
    RobotJointPosition6=angle_4)
robot_target = RobotTarget(Name=name_4, Plane=flip_plane_x, Set_External_Joint_Position=False, Set_Reference_Plane=False)
robot_target_2 = RobotTarget(Name=name_5, Plane=flip_plane_x_2, Set_External_Joint_Position=False, Set_Reference_Plane=False)
speed = Speed({"v5": 5, "v10": 10, "v20": 20, "v30": 30, "v40": 40, "v50": 50, "v60": 60, "v80": 80, "v100": 100, "v150": 150, "v200": 200, "v300": 300, "v400": 400, "v500": 500, "v600": 600, "v800": 800, "v1000": 1000, "v1500": 1500, "v2000": 2000, "v2500": 2500, "v3000": 3000, "v4000": 4000, "v5000": 5000, "v6000": 6000, "v7000": 7000}, selected="v200")
zone = Zone({"z0": 0, "z1": 1, "z5": 5, "z10": 10, "z15": 15, "z20": 20, "z30": 30, "z40": 40, "z50": 50, "z60": 60, "z80": 80, "z100": 100, "z150": 150, "z200": 200, "fine": -1}, selected="fine")
task_list = TaskList(Name=name, TaskNames=task_names)
rotate_plane = RotatePlane(Plane=xy_plane_3, Angle=degrees(angle))
rotate_plane_2 = RotatePlane(Plane=xy_plane_4, Angle=degrees(angle_2))
in_position = Panel("True")
sync_id = Panel("together")
sync_id_2 = Panel("ready")
sync_id_3 = Panel("apart")
wait_sync_task = WaitSyncTask(SyncID=sync_id_2, TaskList=task_list, InPosition=in_position)
sync_move_on = SyncMoveOn(SyncID=sync_id, TaskList=task_list)
move = Move(
    Type=movement_type,
    Target=robot_joint_position,
    SpeedData=speed,
    ZoneData=zone,
    Override_Robot_Tool=False,
    Override_Work_Object=False,
    Set_Circular_Point=False,
    Set_Digital_Output=False,
    Set_Movement_Time=False)
move_2 = Move(
    Type=movement_type_2,
    Target=robot_target,
    SpeedData=speed,
    ZoneData=zone,
    Override_Robot_Tool=False,
    Override_Work_Object=False,
    Set_Circular_Point=False,
    Set_Digital_Output=False,
    Set_Movement_Time=False)
move_3 = Move(
    Type=movement_type_3,
    Target=robot_joint_position_2,
    SpeedData=speed,
    ZoneData=zone,
    Override_Robot_Tool=False,
    Override_Work_Object=False,
    Set_Circular_Point=False,
    Set_Digital_Output=False,
    Set_Movement_Time=False)
move_4 = Move(
    Type=movement_type_2,
    Target=robot_target_2,
    SpeedData=speed,
    ZoneData=zone,
    Override_Robot_Tool=False,
    Override_Work_Object=False,
    Set_Circular_Point=False,
    Set_Digital_Output=False,
    Set_Movement_Time=False)
sync_move_off = SyncMoveOff(SyncID=sync_id_3)
robot_preset = RobotPreset(PositionPlane=rotate_plane, Robot_Preset_Number=4)
robot_preset_2 = RobotPreset(PositionPlane=rotate_plane_2, Robot_Preset_Number=4)
rapid_generator = RAPIDGenerator(
    Robot=robot_preset,
    Actions=flatten([move, wait_sync_task, sync_move_on, move_2, sync_move_off]),
    Add_loaddata=False,
    Add_tooldata=False,
    Add_wobjdata=False,
    Additional_Routines=False,
    Author=False,
    Enforce_Axis_Limits=False,
    Error_Handling=False,
    Is_System_Module=False,
    Main_Module=False,
    Module_Name=False,
    Output_loaddata=False,
    Output_tooldata=False,
    Output_wobjdata=False,
    Routine_Name=False,
    Routine_Scope=False)
rapid_generator_2 = RAPIDGenerator(
    Robot=robot_preset_2,
    Actions=flatten([move_3, wait_sync_task, sync_move_on, move_4, sync_move_off]),
    Add_loaddata=False,
    Add_tooldata=False,
    Add_wobjdata=False,
    Additional_Routines=False,
    Author=False,
    Enforce_Axis_Limits=False,
    Error_Handling=False,
    Is_System_Module=False,
    Main_Module=False,
    Module_Name=False,
    Output_loaddata=False,
    Output_tooldata=False,
    Output_wobjdata=False,
    Routine_Name=False,
    Routine_Scope=False)
task_t_rob1 = Panel(rapid_generator)
task_t_rob2 = Panel(rapid_generator_2)
