# Grasshopper definition pen-on-table.gh (Grasshopper 1.0.8)
# plug-ins: Robot Components

X = Slider(350, range=0..600)
Y = Slider(-150, range=-300..300)
Z = Slider(150, range=0..500)
construct_point = ConstructPoint(XCoordinate=X, YCoordinate=Y, ZCoordinate=Z)
angle = Slider(30, range=-90..90)
xy_plane = XYPlane(Origin=construct_point)
size = Slider(100, range=50..200)
rotate_plane = RotatePlane(Plane=xy_plane, Angle=degrees(angle))
rectangle = Rectangle(Plane=rotate_plane, XSize=size, YSize=size, Radius=0)  # -> Rectangle, Length
discontinuity = Discontinuity(Curve=rectangle.Rectangle, Level=1)  # -> Points, Parameters
pen_length = Panel("120")
construct_point_2 = ConstructPoint(XCoordinate=0, YCoordinate=0, ZCoordinate=pen_length)
plane_origin = PlaneOrigin(Base=rotate_plane, Origin=discontinuity.Points)
xy_plane_2 = XYPlane(Origin=Point(0, 0, 0))
xy_plane_3 = XYPlane(Origin=construct_point_2)
flip_plane_x = FlipPlaneX(Plane=plane_origin)
angle_j5 = Panel("30")
angle_2 = Panel("0")
name = Panel("table")
name_2 = Panel("pen")
name_3 = Panel("home")
name_4 = Panel("p")
movement_type = MovementType({"MoveAbsJ": 0, "MoveL": 1, "MoveJ": 2, "MoveC": 3}, selected="MoveAbsJ")
movement_type_2 = MovementType({"MoveAbsJ": 0, "MoveL": 1, "MoveJ": 2, "MoveC": 3}, selected="MoveL")
robot_joint_position = RobotJointPosition(
    Name=name_3,
    RobotJointPosition1=angle_2,
    RobotJointPosition2=angle_2,
    RobotJointPosition3=angle_2,
    RobotJointPosition4=angle_2,
    RobotJointPosition5=angle_j5,
    RobotJointPosition6=angle_2)
robot_target = RobotTarget(
    Name=name_4,
    Plane=flip_plane_x,
    ReferencePlane=rotate_plane,
    Set_External_Joint_Position=False,
    Set_Reference_Plane=True)
robot_tool = RobotTool(Name=name_2, AttachmentPlane=xy_plane_2, ToolPlane=xy_plane_3)
speed = Speed({"v5": 5, "v10": 10, "v20": 20, "v30": 30, "v40": 40, "v50": 50, "v60": 60, "v80": 80, "v100": 100, "v150": 150, "v200": 200, "v300": 300, "v400": 400, "v500": 500, "v600": 600, "v800": 800, "v1000": 1000, "v1500": 1500, "v2000": 2000, "v2500": 2500, "v3000": 3000, "v4000": 4000, "v5000": 5000, "v6000": 6000, "v7000": 7000}, selected="v100")
work_object = WorkObject(Name=name, Plane=rotate_plane)
zone = Zone({"z0": 0, "z1": 1, "z5": 5, "z10": 10, "z15": 15, "z20": 20, "z30": 30, "z40": 40, "z50": 50, "z60": 60, "z80": 80, "z100": 100, "z150": 150, "z200": 200, "fine": -1}, selected="z10")
zone_2 = Zone({"z0": 0, "z1": 1, "z5": 5, "z10": 10, "z15": 15, "z20": 20, "z30": 30, "z40": 40, "z50": 50, "z60": 60, "z80": 80, "z100": 100, "z150": 150, "z200": 200, "fine": -1}, selected="fine")
xy_plane_4 = XYPlane(Origin=Point(0, 0, 0))
move = Move(
    Type=movement_type_2,
    Target=robot_target,
    SpeedData=speed,
    ZoneData=zone_2,
    WorkObject=work_object,
    Override_Robot_Tool=False,
    Override_Work_Object=True,
    Set_Circular_Point=False,
    Set_Digital_Output=False,
    Set_Movement_Time=False)
move_2 = Move(
    Type=movement_type,
    Target=robot_joint_position,
    SpeedData=speed,
    ZoneData=zone,
    Override_Robot_Tool=False,
    Override_Work_Object=False,
    Set_Circular_Point=False,
    Set_Digital_Output=False,
    Set_Movement_Time=False)
robot_preset = RobotPreset(PositionPlane=xy_plane_4, RobotTool=robot_tool, Robot_Preset_Number=4)
add_tooldata = Panel("True")
add_wobjdata = Panel("True")
rapid_generator = RAPIDGenerator(
    Robot=robot_preset,
    Actions=flatten([move_2, move]),
    AddTooldata=add_tooldata,
    AddWobjdata=add_wobjdata,
    Add_loaddata=False,
    Add_tooldata=True,
    Add_wobjdata=True,
    Additional_Routines=False,
    Author=False,
    Enforce_Axis_Limits=False,
    Error_Handling=False,
    Is_System_Module=False,
    Main_Module=False,
    Module_Name=False,
    Output_loaddata=False,
    Output_tooldata=False,
    Output_wobjdata=False,
    Routine_Name=False,
    Routine_Scope=False)
rapid_module = Panel(rapid_generator)
