# Grasshopper definition pick-and-place.gh (Grasshopper 1.0.8)
# plug-ins: Robot Components

X = Panel("400")
Y = Panel("-150")
Z = Panel("200")
X_2 = Panel("400")
Y_2 = Panel("-150")
Z_2 = Panel("300")
X_3 = Panel("400")
Y_3 = Panel("150")
Z_3 = Panel("200")
X_4 = Panel("400")
Y_4 = Panel("150")
Z_4 = Panel("300")
construct_point = ConstructPoint(XCoordinate=X, YCoordinate=Y, ZCoordinate=Z)
construct_point_2 = ConstructPoint(XCoordinate=X_2, YCoordinate=Y_2, ZCoordinate=Z_2)
construct_point_3 = ConstructPoint(XCoordinate=X_3, YCoordinate=Y_3, ZCoordinate=Z_3)
construct_point_4 = ConstructPoint(XCoordinate=X_4, YCoordinate=Y_4, ZCoordinate=Z_4)
xy_plane = XYPlane(Origin=construct_point)
xy_plane_2 = XYPlane(Origin=construct_point_2)
xy_plane_3 = XYPlane(Origin=construct_point_3)
xy_plane_4 = XYPlane(Origin=construct_point_4)
flip_plane_x = FlipPlaneX(Plane=xy_plane)
flip_plane_x_2 = FlipPlaneX(Plane=xy_plane_2)
flip_plane_x_3 = FlipPlaneX(Plane=xy_plane_3)
flip_plane_x_4 = FlipPlaneX(Plane=xy_plane_4)
name = Panel("place_above")
name_2 = Panel("pick_above")
angle_j5 = Panel("30")
angle = Panel("0")
name_3 = Panel("place")
name_4 = Panel("home")
name_5 = Panel("pick")
movement_type = MovementType({"MoveAbsJ": 0, "MoveL": 1, "MoveJ": 2, "MoveC": 3}, selected="MoveAbsJ")
movement_type_2 = MovementType({"MoveAbsJ": 0, "MoveL": 1, "MoveJ": 2, "MoveC": 3}, selected="MoveJ")
movement_type_3 = MovementType({"MoveAbsJ": 0, "MoveL": 1, "MoveJ": 2, "MoveC": 3}, selected="MoveL")
robot_joint_position = RobotJointPosition(
    Name=name_4,
    RobotJointPosition1=angle,
    RobotJointPosition2=angle,
    RobotJointPosition3=angle,
    RobotJointPosition4=angle,
    RobotJointPosition5=angle_j5,
    RobotJointPosition6=angle)
robot_target = RobotTarget(Name=name_5, Plane=flip_plane_x, Set_External_Joint_Position=False, Set_Reference_Plane=False)
robot_target_2 = RobotTarget(Name=name_2, Plane=flip_plane_x_2, Set_External_Joint_Position=False, Set_Reference_Plane=False)
robot_target_3 = RobotTarget(Name=name_3, Plane=flip_plane_x_3, Set_External_Joint_Position=False, Set_Reference_Plane=False)
robot_target_4 = RobotTarget(Name=name, Plane=flip_plane_x_4, Set_External_Joint_Position=False, Set_Reference_Plane=False)
speed = Speed({"v5": 5, "v10": 10, "v20": 20, "v30": 30, "v40": 40, "v50": 50, "v60": 60, "v80": 80, "v100": 100, "v150": 150, "v200": 200, "v300": 300, "v400": 400, "v500": 500, "v600": 600, "v800": 800, "v1000": 1000, "v1500": 1500, "v2000": 2000, "v2500": 2500, "v3000": 3000, "v4000": 4000, "v5000": 5000, "v6000": 6000, "v7000": 7000}, selected="v200")
speed_2 = Speed({"v5": 5, "v10": 10, "v20": 20, "v30": 30, "v40": 40, "v50": 50, "v60": 60, "v80": 80, "v100": 100, "v150": 150, "v200": 200, "v300": 300, "v400": 400, "v500": 500, "v600": 600, "v800": 800, "v1000": 1000, "v1500": 1500, "v2000": 2000, "v2500": 2500, "v3000": 3000, "v4000": 4000, "v5000": 5000, "v6000": 6000, "v7000": 7000}, selected="v50")
zone = Zone({"z0": 0, "z1": 1, "z5": 5, "z10": 10, "z15": 15, "z20": 20, "z30": 30, "z40": 40, "z50": 50, "z60": 60, "z80": 80, "z100": 100, "z150": 150, "z200": 200, "fine": -1}, selected="z10")
zone_2 = Zone({"z0": 0, "z1": 1, "z5": 5, "z10": 10, "z15": 15, "z20": 20, "z30": 30, "z40": 40, "z50": 50, "z60": 60, "z80": 80, "z100": 100, "z150": 150, "z200": 200, "fine": -1}, selected="fine")
xy_plane_5 = XYPlane(Origin=Point(0, 0, 0))
signal = Panel("doGripper")
signal_2 = Panel("doGripper")
seconds = Panel("0.5")
seconds_2 = Panel("0.5")
close = Panel("1")
open = Panel("0")
set_digital_output = SetDigitalOutput(Name=signal, State=close)
set_digital_output_2 = SetDigitalOutput(Name=signal_2, State=open)
move = Move(
    Type=movement_type,
    Target=robot_joint_position,
    SpeedData=speed,
    ZoneData=zone,
    Override_Robot_Tool=False,
    Override_Work_Object=False,
    Set_Circular_Point=False,
    Set_Digital_Output=False,
    Set_Movement_Time=False)
move_2 = Move(
    Type=movement_type_2,
    Target=robot_target_2,
    SpeedData=speed,
    ZoneData=zone,
    Override_Robot_Tool=False,
    Override_Work_Object=False,
    Set_Circular_Point=False,
    Set_Digital_Output=False,
    Set_Movement_Time=False)
move_3 = Move(
    Type=movement_type_3,
    Target=robot_target,
    SpeedData=speed_2,
    ZoneData=zone_2,
    Override_Robot_Tool=False,
    Override_Work_Object=False,
    Set_Circular_Point=False,
    Set_Digital_Output=False,
    Set_Movement_Time=False)
move_4 = Move(
    Type=movement_type_3,
    Target=robot_target_2,
    SpeedData=speed_2,
    ZoneData=zone,
    Override_Robot_Tool=False,
    Override_Work_Object=False,
    Set_Circular_Point=False,
    Set_Digital_Output=False,
    Set_Movement_Time=False)
move_5 = Move(
    Type=movement_type_2,
    Target=robot_target_4,
    SpeedData=speed,
    ZoneData=zone,
    Override_Robot_Tool=False,
    Override_Work_Object=False,
    Set_Circular_Point=False,
    Set_Digital_Output=False,
    Set_Movement_Time=False)
move_6 = Move(
    Type=movement_type_3,
    Target=robot_target_3,
    SpeedData=speed_2,
    ZoneData=zone_2,
    Override_Robot_Tool=False,
    Override_Work_Object=False,
    Set_Circular_Point=False,
    Set_Digital_Output=False,
    Set_Movement_Time=False)
move_7 = Move(
    Type=movement_type_3,
    Target=robot_target_4,
    SpeedData=speed_2,
    ZoneData=zone_2,
    Override_Robot_Tool=False,
    Override_Work_Object=False,
    Set_Circular_Point=False,
    Set_Digital_Output=False,
    Set_Movement_Time=False)
wait_time = WaitTime(InPosition=False, Duration=seconds)
wait_time_2 = WaitTime(InPosition=False, Duration=seconds_2)
robot_preset = RobotPreset(PositionPlane=xy_plane_5, Robot_Preset_Number=4)
rapid_generator = RAPIDGenerator(
    Robot=robot_preset,
    Actions=flatten([move, move_2, move_3, set_digital_output, wait_time, move_4, move_5, move_6, set_digital_output_2, wait_time_2, move_7]),
    Add_loaddata=False,
    Add_tooldata=False,
    Add_wobjdata=False,
    Additional_Routines=False,
    Author=False,
    Enforce_Axis_Limits=False,
    Error_Handling=False,
    Is_System_Module=False,
    Main_Module=False,
    Module_Name=False,
    Output_loaddata=False,
    Output_tooldata=False,
    Output_wobjdata=False,
    Routine_Name=False,
    Routine_Scope=False)
rapid_module = Panel(rapid_generator)
