# Grasshopper definition current-z-func.gh (Grasshopper 1.0.8)
# plug-ins: Robot Components

X = Slider(400, range=0..600)
Y = Slider(0, range=-300..300)
Z = Slider(300, range=0..800)
construct_point = ConstructPoint(XCoordinate=X, YCoordinate=Y, ZCoordinate=Z)
keyword = Keyword({"VAR": 0, "PERS": 1, "INOUT": 2, "CONST": 3}, selected="VAR")
scope = Scope({"GLOBAL": 0, "LOCAL": 1, "TASK": 2}, selected="LOCAL")
level = Level({"Module": 0, "Routine": 1}, selected="Routine")
xy_plane = XYPlane(Origin=construct_point)
type = Panel("robtarget")
name = Panel("now")
rapid_variable = RAPIDVariable(Level=level, Scope=scope, Keyword=keyword, Type=type, Name=name, ArraySizeInputParam=False)  # -> Variable, VariableDeclaration
flip_plane_x = FlipPlaneX(Plane=xy_plane)
name_2 = Panel("target")
robot_target = RobotTarget(Name=name_2, Plane=flip_plane_x, Set_External_Joint_Position=False, Set_Reference_Plane=False)
current_robot_target = CurrentRobotTarget()
list = ValueList({"GLOBAL": 0, "LOCAL": 1, "TASK": 2}, selected="GLOBAL")
list_2 = ValueList({"Module": 0, "Routine": 1}, selected="Module")
list_3 = ValueList({"VAR": 0, "PERS": 1, "INOUT": 2, "CONST": 3}, selected="VAR")
get_robtarget_members = GetRobtargetMembers(Variable=rapid_variable.Variable, ConfigOutputs=False, ExternalOutputs=False, RotationOutputs=False)  # -> X, Y, Z
offset = Panel("0")
value = Panel("0")
type_2 = Panel("num")
name_3 = Panel("z")
Z_2 = Panel("-50")
movement_type = MovementType({"MoveAbsJ": 0, "MoveL": 1, "MoveJ": 2, "MoveC": 3}, selected="MoveL")
scope_2 = Scope({"GLOBAL": 0, "LOCAL": 1, "TASK": 2}, selected="GLOBAL")
rapid_variable_2 = RAPIDVariable(Level=list_2, Scope=list, Keyword=list_3, Type=type_2, Name=name_3, Value=value, ArraySizeInputParam=False)  # -> Variable, VariableDeclaration
speed = Speed({"v5": 5, "v10": 10, "v20": 20, "v30": 30, "v40": 40, "v50": 50, "v60": 60, "v80": 80, "v100": 100, "v150": 150, "v200": 200, "v300": 300, "v400": 400, "v500": 500, "v600": 600, "v800": 800, "v1000": 1000, "v1500": 1500, "v2000": 2000, "v2500": 2500, "v3000": 3000, "v4000": 4000, "v5000": 5000, "v6000": 6000, "v7000": 7000}, selected="v200")
operator = Operator({"<": 0, ">": 1, "<=": 2, ">=": 3, "＝": 4, "<>": 5}, selected=">=")
type_3 = Type({"PROC": 0, "FUNC": 1, "TRAP": 2}, selected="FUNC")
zone = Zone({"z0": 0, "z1": 1, "z5": 5, "z10": 10, "z15": 15, "z20": 20, "z30": 30, "z40": 40, "z50": 50, "z60": 60, "z80": 80, "z100": 100, "z150": 150, "z200": 200, "fine": -1}, selected="fine")
assign_variable_value = AssignVariableValue(Variable=rapid_variable.Variable, Value=current_robot_target, ArrayIndexInputParam=False, ArrayValuesInputParam=False)  # -> Variable, Assignment
return = Return(ReturnValue=get_robtarget_members.Z)
offset_target = OffsetTarget(Target=robot_target, X=offset, Y=offset, Z=Z_2)
return_type = Panel("num")
angle_j5 = Panel("30")
name_4 = Panel("currentZ")
angle = Panel("0")
limit = Panel("299")
name_5 = Panel("home")
movement_type_2 = MovementType({"MoveAbsJ": 0, "MoveL": 1, "MoveJ": 2, "MoveC": 3}, selected="MoveAbsJ")
movement_type_3 = MovementType({"MoveAbsJ": 0, "MoveL": 1, "MoveJ": 2, "MoveC": 3}, selected="MoveJ")
robot_joint_position = RobotJointPosition(
    Name=name_5,
    RobotJointPosition1=angle,
    RobotJointPosition2=angle,
    RobotJointPosition3=angle,
    RobotJointPosition4=angle,
    RobotJointPosition5=angle_j5,
    RobotJointPosition6=angle)
routine = Routine(
    Actions=[rapid_variable.VariableDeclaration, assign_variable_value.Assignment, return],
    Type=type_3,
    Name=name_4,
    Scope=scope_2,
    ReturnType=return_type,
    IsFunc=True)  # -> Routine, RoutineCall, ReturnValue
move = Move(
    Type=movement_type,
    Target=offset_target,
    SpeedData=speed,
    ZoneData=zone,
    Override_Robot_Tool=False,
    Override_Work_Object=False,
    Set_Circular_Point=False,
    Set_Digital_Output=False,
    Set_Movement_Time=False)
zone_2 = Zone({"z0": 0, "z1": 1, "z5": 5, "z10": 10, "z15": 15, "z20": 20, "z30": 30, "z40": 40, "z50": 50, "z60": 60, "z80": 80, "z100": 100, "z150": 150, "z200": 200, "fine": -1}, selected="z10")
comparison_expression = ComparisonExpression(A=rapid_variable_2.Variable, Operator=operator, B=limit)
xy_plane_2 = XYPlane(Origin=Point(0, 0, 0))
if_statement = IFStatement(IFCondition=comparison_expression, IFActions=move)  # -> flatten(IFStatement)
move_2 = Move(
    Type=movement_type_2,
    Target=robot_joint_position,
    SpeedData=speed,
    ZoneData=zone_2,
    Override_Robot_Tool=False,
    Override_Work_Object=False,
    Set_Circular_Point=False,
    Set_Digital_Output=False,
    Set_Movement_Time=False)
move_3 = Move(
    Type=movement_type_3,
    Target=robot_target,
    SpeedData=speed,
    ZoneData=zone,
    Override_Robot_Tool=False,
    Override_Work_Object=False,
    Set_Circular_Point=False,
    Set_Digital_Output=False,
    Set_Movement_Time=False)
robot_preset = RobotPreset(PositionPlane=xy_plane_2, Robot_Preset_Number=4)
assign_variable_value_2 = AssignVariableValue(Variable=rapid_variable_2.Variable, Value=routine.ReturnValue, ArrayIndexInputParam=False, ArrayValuesInputParam=False)  # -> Variable, Assignment
rapid_generator = RAPIDGenerator(
    Robot=robot_preset,
    Actions=[rapid_variable_2.VariableDeclaration, move_2, move_3, assign_variable_value_2.Assignment, if_statement],
    AdditionalRoutines=routine.Routine,
    Add_loaddata=False,
    Add_tooldata=False,
    Add_wobjdata=False,
    Additional_Routines=True,
    Author=False,
    Enforce_Axis_Limits=False,
    Error_Handling=False,
    Is_System_Module=False,
    Main_Module=False,
    Module_Name=False,
    Output_loaddata=False,
    Output_tooldata=False,
    Output_wobjdata=False,
    Routine_Name=False,
    Routine_Scope=False)
rapid_module = Panel(rapid_generator)
