# Grasshopper definition operator-loop.gh (Grasshopper 1.0.8)
# plug-ins: Robot Components

X = Slider(400, range=0..600)
Y = Slider(0, range=-300..300)
Z = Slider(200, range=0..800)
construct_point = ConstructPoint(XCoordinate=X, YCoordinate=Y, ZCoordinate=Z)
xy_plane = XYPlane(Origin=construct_point)
keyword = Keyword({"VAR": 0, "PERS": 1, "INOUT": 2, "CONST": 3}, selected="VAR")
keyword_2 = Keyword({"VAR": 0, "PERS": 1, "INOUT": 2, "CONST": 3}, selected="VAR")
scope = Scope({"GLOBAL": 0, "LOCAL": 1, "TASK": 2}, selected="GLOBAL")
scope_2 = Scope({"GLOBAL": 0, "LOCAL": 1, "TASK": 2}, selected="GLOBAL")
level = Level({"Module": 0, "Routine": 1}, selected="Module")
level_2 = Level({"Module": 0, "Routine": 1}, selected="Module")
flip_plane_x = FlipPlaneX(Plane=xy_plane)
name = Panel("again")
value = Panel("TRUE")
value_2 = Panel("100")
type = Panel("bool")
type_2 = Panel("num")
name_2 = Panel("h")
name_3 = Panel("base")
robot_target = RobotTarget(Name=name_3, Plane=flip_plane_x, Set_External_Joint_Position=False, Set_Reference_Plane=False)
rapid_variable = RAPIDVariable(Level=level, Scope=scope, Keyword=keyword, Type=type, Name=name, Value=value, ArraySizeInputParam=False)  # -> Variable, VariableDeclaration
rapid_variable_2 = RAPIDVariable(Level=level_2, Scope=scope_2, Keyword=keyword_2, Type=type_2, Name=name_2, Value=value_2, ArraySizeInputParam=False)  # -> Variable, VariableDeclaration
offset = Panel("0")
value_3 = Panel("FALSE")
zone_data = ZoneData({"z0": 0, "z1": 1, "z5": 5, "z10": 10, "z15": 15, "z20": 20, "z30": 30, "z40": 40, "z50": 50, "z60": 60, "z80": 80, "z100": 100, "z150": 150, "z200": 200, "fine": -1}, selected="fine")
type_3 = Type({"MoveAbsJ": 0, "MoveL": 1, "MoveJ": 2, "MoveC": 3}, selected="MoveJ")
message = Panel("Height above base in mm?")
speed = Speed({"v5": 5, "v10": 10, "v20": 20, "v30": 30, "v40": 40, "v50": 50, "v60": 60, "v80": 80, "v100": 100, "v150": 150, "v200": 200, "v300": 300, "v400": 400, "v500": 500, "v600": 600, "v800": 800, "v1000": 1000, "v1500": 1500, "v2000": 2000, "v2500": 2500, "v3000": 3000, "v4000": 4000, "v5000": 5000, "v6000": 6000, "v7000": 7000}, selected="v200")
message_2 = Panel("Run another cycle?")
assign_variable_value = AssignVariableValue(Variable=rapid_variable.Variable, Value=value_3, ArrayIndexInputParam=False, ArrayValuesInputParam=False)  # -> Variable, Assignment
offset_target = OffsetTarget(Target=robot_target, X=offset, Y=offset, Z=rapid_variable_2.Variable)
empty_line = EmptyLine(TypeInputParam=False)
as_integer = Panel("True")
angle_j5 = Panel("30")
range = Panel("0 To 300")
buttons = Panel("""Yes
No""")
header = Panel("Cycle")
header_2 = Panel("Height")
angle = Panel("0")
name_4 = Panel("home")
robot_joint_position = RobotJointPosition(
    Name=name_4,
    RobotJointPosition1=angle,
    RobotJointPosition2=angle,
    RobotJointPosition3=angle,
    RobotJointPosition4=angle,
    RobotJointPosition5=angle_j5,
    RobotJointPosition6=angle)
zone_data_2 = ZoneData({"z0": 0, "z1": 1, "z5": 5, "z10": 10, "z15": 15, "z20": 20, "z30": 30, "z40": 40, "z50": 50, "z60": 60, "z80": 80, "z100": 100, "z150": 150, "z200": 200, "fine": -1}, selected="z10")
type_4 = Type({"MoveAbsJ": 0, "MoveL": 1, "MoveJ": 2, "MoveC": 3}, selected="MoveAbsJ")
numeric_entry_box = NumericEntryBox(
    Variable=rapid_variable_2.Variable,
    Header=header_2,
    Message=message,
    InitialValue=rapid_variable_2.Variable,
    Range=range,
    AsInteger=as_integer)  # -> Variable, NumericEntryBox
message_box = MessageBox(Header=header, Message=message_2, Buttons=buttons, ActionsYes=empty_line, ActionsNo=assign_variable_value.Assignment)  # -> flatten(MessageBox)
move = Move(
    Type=type_3,
    Target=offset_target,
    SpeedData=speed,
    ZoneData=zone_data,
    Override_Robot_Tool=False,
    Override_Work_Object=False,
    Set_Circular_Point=False,
    Set_Digital_Output=False,
    Set_Movement_Time=False)
xy_plane_2 = XYPlane(Origin=Point(0, 0, 0))
while_loop = WhileLoop(Condition=rapid_variable.Variable, Actions=[numeric_entry_box.NumericEntryBox, move, message_box])  # -> flatten(WhileLoop)
move_2 = Move(
    Type=type_4,
    Target=robot_joint_position,
    SpeedData=speed,
    ZoneData=zone_data_2,
    Override_Robot_Tool=False,
    Override_Work_Object=False,
    Set_Circular_Point=False,
    Set_Digital_Output=False,
    Set_Movement_Time=False)
robot_preset = RobotPreset(PositionPlane=xy_plane_2, Robot_Preset_Number=4)
rapid_generator = RAPIDGenerator(
    Robot=robot_preset,
    Actions=[rapid_variable.VariableDeclaration, rapid_variable_2.VariableDeclaration, move_2, while_loop],
    Add_loaddata=False,
    Add_tooldata=False,
    Add_wobjdata=False,
    Additional_Routines=False,
    Author=False,
    Enforce_Axis_Limits=False,
    Error_Handling=False,
    Is_System_Module=False,
    Main_Module=False,
    Module_Name=False,
    Output_loaddata=False,
    Output_tooldata=False,
    Output_wobjdata=False,
    Routine_Name=False,
    Routine_Scope=False)
rapid_module = Panel(rapid_generator)
