# Grasshopper definition part-sensor-interrupt.gh (Grasshopper 1.0.8)
# plug-ins: Robot Components

keyword = Keyword({"VAR": 0, "PERS": 1, "INOUT": 2, "CONST": 3}, selected="VAR")
scope = Scope({"GLOBAL": 0, "LOCAL": 1, "TASK": 2}, selected="GLOBAL")
level = Level({"Module": 0, "Routine": 1}, selected="Module")
value = Panel("0")
type = Panel("num")
name = Panel("hits")
rapid_variable = RAPIDVariable(Level=level, Scope=scope, Keyword=keyword, Type=type, Name=name, Value=value, ArraySizeInputParam=False)  # -> Variable, VariableDeclaration
value_2 = Panel("hits + 1")
signal_type = SignalType({"DigitalInput": 0, "DigitalOutput": 1, "AnalogInput": 2, "AnalogOutput": 3, "GroupInput": 4, "GroupOutput": 5, "PersistentData": 6}, selected="DigitalInput")
code = Panel("VAR signaldi diPartSensor;")
scope_2 = Scope({"GLOBAL": 0, "LOCAL": 1, "TASK": 2}, selected="GLOBAL")
type_2 = Type({"PROC": 0, "FUNC": 1, "TRAP": 2}, selected="TRAP")
assign_variable_value = AssignVariableValue(Variable=rapid_variable.Variable, Value=value_2, ArrayIndexInputParam=False, ArrayValuesInputParam=False)  # -> Variable, Assignment
signal = Panel("diPartSensor")
signal_value = Panel("1")
declaration = Panel("1")
trap_name = Panel("partTrap")
name_2 = Panel("partTrap")
seconds = Panel("5")
connect_interrupt = ConnectInterrupt(
    TRAPRoutineName=trap_name,
    SignalName=signal,
    SignalValue=signal_value,
    SignalType=signal_type,
    InterruptNameInputParam=False)  # -> flatten(ConnectCode), EnableInterrupts, DisableInterrupts
wait_time = WaitTime(InPosition=False, Duration=seconds)
routine = Routine(Actions=assign_variable_value.Assignment, Type=type_2, Name=name_2, Scope=scope_2, IsFunc=False)  # -> Routine, RoutineCall
code_2 = Code(Code=code, Type=declaration)  # -> flatten(Code)
rapid_generator = RAPIDGenerator(
    Actions=[code_2, rapid_variable.VariableDeclaration, connect_interrupt.ConnectCode, wait_time],
    AdditionalRoutines=routine.Routine,
    Add_loaddata=False,
    Add_tooldata=False,
    Add_wobjdata=False,
    Additional_Routines=True,
    Author=False,
    Enforce_Axis_Limits=False,
    Error_Handling=False,
    Is_System_Module=False,
    Main_Module=False,
    Module_Name=False,
    Output_loaddata=False,
    Output_tooldata=False,
    Output_wobjdata=False,
    Routine_Name=False,
    Routine_Scope=False)
rapid_module = Panel(rapid_generator)
