# Grasshopper definition row-loop.gh (Grasshopper 1.0.8)
# plug-ins: Robot Components

X = Slider(400, range=0..600)
Y = Slider(-150, range=-300..300)
Z = Slider(300, range=0..800)
construct_point = ConstructPoint(XCoordinate=X, YCoordinate=Y, ZCoordinate=Z)
xy_plane = XYPlane(Origin=construct_point)
flip_plane_x = FlipPlaneX(Plane=xy_plane)
name = Panel("base")
keyword = Keyword({"VAR": 0, "PERS": 1, "INOUT": 2, "CONST": 3}, selected="PERS")
robot_target = RobotTarget(Name=name, Plane=flip_plane_x, Set_External_Joint_Position=False, Set_Reference_Plane=False)
scope = Scope({"GLOBAL": 0, "LOCAL": 1, "TASK": 2}, selected="GLOBAL")
level = Level({"Module": 0, "Routine": 1}, selected="Module")
Y_2 = Panel("i * 100")
offset = Panel("0")
name_2 = Panel("count")
value = Panel("0")
type = Panel("num")
movement_type = MovementType({"MoveAbsJ": 0, "MoveL": 1, "MoveJ": 2, "MoveC": 3}, selected="MoveL")
rapid_variable = RAPIDVariable(Level=level, Scope=scope, Keyword=keyword, Type=type, Name=name_2, Value=value, ArraySizeInputParam=False)  # -> Variable, VariableDeclaration
speed = Speed({"v5": 5, "v10": 10, "v20": 20, "v30": 30, "v40": 40, "v50": 50, "v60": 60, "v80": 80, "v100": 100, "v150": 150, "v200": 200, "v300": 300, "v400": 400, "v500": 500, "v600": 600, "v800": 800, "v1000": 1000, "v1500": 1500, "v2000": 2000, "v2500": 2500, "v3000": 3000, "v4000": 4000, "v5000": 5000, "v6000": 6000, "v7000": 7000}, selected="v200")
operator = Operator({"<": 0, ">": 1, "<=": 2, ">=": 3, "＝": 4, "<>": 5}, selected=">=")
zone = Zone({"z0": 0, "z1": 1, "z5": 5, "z10": 10, "z15": 15, "z20": 20, "z30": 30, "z40": 40, "z50": 50, "z60": 60, "z80": 80, "z100": 100, "z150": 150, "z200": 200, "fine": -1}, selected="fine")
offset_target = OffsetTarget(Target=robot_target, X=offset, Y=Y_2, Z=offset)
value_2 = Panel("count + 1")
angle_j5 = Panel("30")
angle = Panel("0")
limit = Panel("100")
value_3 = Panel("0")
name_3 = Panel("home")
movement_type_2 = MovementType({"MoveAbsJ": 0, "MoveL": 1, "MoveJ": 2, "MoveC": 3}, selected="MoveAbsJ")
movement_type_3 = MovementType({"MoveAbsJ": 0, "MoveL": 1, "MoveJ": 2, "MoveC": 3}, selected="MoveJ")
robot_joint_position = RobotJointPosition(
    Name=name_3,
    RobotJointPosition1=angle,
    RobotJointPosition2=angle,
    RobotJointPosition3=angle,
    RobotJointPosition4=angle,
    RobotJointPosition5=angle_j5,
    RobotJointPosition6=angle)
move = Move(
    Type=movement_type,
    Target=offset_target,
    SpeedData=speed,
    ZoneData=zone,
    Override_Robot_Tool=False,
    Override_Work_Object=False,
    Set_Circular_Point=False,
    Set_Digital_Output=False,
    Set_Movement_Time=False)
zone_2 = Zone({"z0": 0, "z1": 1, "z5": 5, "z10": 10, "z15": 15, "z20": 20, "z30": 30, "z40": 40, "z50": 50, "z60": 60, "z80": 80, "z100": 100, "z150": 150, "z200": 200, "fine": -1}, selected="z10")
assign_variable_value = AssignVariableValue(Variable=rapid_variable.Variable, Value=value_2, ArrayIndexInputParam=False, ArrayValuesInputParam=False)  # -> Variable, Assignment
assign_variable_value_2 = AssignVariableValue(Variable=rapid_variable.Variable, Value=value_3, ArrayIndexInputParam=False, ArrayValuesInputParam=False)  # -> Variable, Assignment
comparison_expression = ComparisonExpression(A=rapid_variable.Variable, Operator=operator, B=limit)
xy_plane_2 = XYPlane(Origin=Point(0, 0, 0))
from = Panel("0")
to = Panel("3")
if_statement = IFStatement(IFCondition=comparison_expression, IFActions=assign_variable_value_2.Assignment)
move_2 = Move(
    Type=movement_type_2,
    Target=robot_joint_position,
    SpeedData=speed,
    ZoneData=zone_2,
    Override_Robot_Tool=False,
    Override_Work_Object=False,
    Set_Circular_Point=False,
    Set_Digital_Output=False,
    Set_Movement_Time=False)
move_3 = Move(
    Type=movement_type_3,
    Target=robot_target,
    SpeedData=speed,
    ZoneData=zone,
    Override_Robot_Tool=False,
    Override_Work_Object=False,
    Set_Circular_Point=False,
    Set_Digital_Output=False,
    Set_Movement_Time=False)
robot_preset = RobotPreset(PositionPlane=xy_plane_2, Robot_Preset_Number=4)
for_loop = ForLoop(From=from, To=to, Actions=[move, assign_variable_value.Assignment])  # -> ForLoop, Counter
rapid_generator = RAPIDGenerator(
    Robot=robot_preset,
    Actions=flatten([rapid_variable.VariableDeclaration, move_2, move_3, for_loop.ForLoop, if_statement]),
    Add_loaddata=False,
    Add_tooldata=False,
    Add_wobjdata=False,
    Additional_Routines=False,
    Author=False,
    Enforce_Axis_Limits=False,
    Error_Handling=False,
    Is_System_Module=False,
    Main_Module=False,
    Module_Name=False,
    Output_loaddata=False,
    Output_tooldata=False,
    Output_wobjdata=False,
    Routine_Name=False,
    Routine_Scope=False)
rapid_module = Panel(rapid_generator)
