# Grasshopper definition visit-routine.gh (Grasshopper 1.0.8)
# plug-ins: Robot Components

X = Slider(400, range=0..600)
Y = Slider(0, range=-300..300)
Z = Slider(300, range=0..800)
construct_point = ConstructPoint(XCoordinate=X, YCoordinate=Y, ZCoordinate=Z)
xy_plane = XYPlane(Origin=construct_point)
flip_plane_x = FlipPlaneX(Plane=xy_plane)
name = Panel("base")
type = Panel("num")
name_2 = Panel("y")
robot_target = RobotTarget(Name=name, Plane=flip_plane_x, Set_External_Joint_Position=False, Set_Reference_Plane=False)
routine_argument = RoutineArgument(Type=type, Name=name_2)  # -> Argument, Variable
z_above = Panel("100")
offset = Panel("0")
movement_type = MovementType({"MoveAbsJ": 0, "MoveL": 1, "MoveJ": 2, "MoveC": 3}, selected="MoveJ")
movement_type_2 = MovementType({"MoveAbsJ": 0, "MoveL": 1, "MoveJ": 2, "MoveC": 3}, selected="MoveL")
speed = Speed({"v5": 5, "v10": 10, "v20": 20, "v30": 30, "v40": 40, "v50": 50, "v60": 60, "v80": 80, "v100": 100, "v150": 150, "v200": 200, "v300": 300, "v400": 400, "v500": 500, "v600": 600, "v800": 800, "v1000": 1000, "v1500": 1500, "v2000": 2000, "v2500": 2500, "v3000": 3000, "v4000": 4000, "v5000": 5000, "v6000": 6000, "v7000": 7000}, selected="v200")
zone = Zone({"z0": 0, "z1": 1, "z5": 5, "z10": 10, "z15": 15, "z20": 20, "z30": 30, "z40": 40, "z50": 50, "z60": 60, "z80": 80, "z100": 100, "z150": 150, "z200": 200, "fine": -1}, selected="z10")
zone_2 = Zone({"z0": 0, "z1": 1, "z5": 5, "z10": 10, "z15": 15, "z20": 20, "z30": 30, "z40": 40, "z50": 50, "z60": 60, "z80": 80, "z100": 100, "z150": 150, "z200": 200, "fine": -1}, selected="fine")
offset_target = OffsetTarget(Target=robot_target, X=offset, Y=routine_argument.Variable, Z=z_above)
offset_target_2 = OffsetTarget(Target=robot_target, X=offset, Y=routine_argument.Variable, Z=offset)
angle_j5 = Panel("30")
angle = Panel("0")
name_3 = Panel("home")
movement_type_3 = MovementType({"MoveAbsJ": 0, "MoveL": 1, "MoveJ": 2, "MoveC": 3}, selected="MoveAbsJ")
robot_joint_position = RobotJointPosition(
    Name=name_3,
    RobotJointPosition1=angle,
    RobotJointPosition2=angle,
    RobotJointPosition3=angle,
    RobotJointPosition4=angle,
    RobotJointPosition5=angle_j5,
    RobotJointPosition6=angle)
move = Move(
    Type=movement_type,
    Target=offset_target,
    SpeedData=speed,
    ZoneData=zone,
    Override_Robot_Tool=False,
    Override_Work_Object=False,
    Set_Circular_Point=False,
    Set_Digital_Output=False,
    Set_Movement_Time=False)
move_2 = Move(
    Type=movement_type_2,
    Target=offset_target_2,
    SpeedData=speed,
    ZoneData=zone_2,
    Override_Robot_Tool=False,
    Override_Work_Object=False,
    Set_Circular_Point=False,
    Set_Digital_Output=False,
    Set_Movement_Time=False)
move_3 = Move(
    Type=movement_type_2,
    Target=offset_target,
    SpeedData=speed,
    ZoneData=zone_2,
    Override_Robot_Tool=False,
    Override_Work_Object=False,
    Set_Circular_Point=False,
    Set_Digital_Output=False,
    Set_Movement_Time=False)
zone_3 = Zone({"z0": 0, "z1": 1, "z5": 5, "z10": 10, "z15": 15, "z20": 20, "z30": 30, "z40": 40, "z50": 50, "z60": 60, "z80": 80, "z100": 100, "z150": 150, "z200": 200, "fine": -1}, selected="z10")
list = ValueList({"GLOBAL": 0, "LOCAL": 1, "TASK": 2}, selected="GLOBAL")
xy_plane_2 = XYPlane(Origin=Point(0, 0, 0))
list_2 = ValueList({"PROC": 0, "FUNC": 1, "TRAP": 2}, selected="PROC")
y_values = Panel("""-150
150""")
name_4 = Panel("visit")
proc = Panel("0")
routine_call = RoutineCall(Type=proc, RoutineName=name_4, ArgumentValue1=y_values)  # -> RoutineCall, RoutineCallExpression
routine = Routine(Actions=[move, move_2, move_3], Type=list_2, Name=name_4, Scope=list, Argument1=routine_argument.Argument, IsFunc=False)  # -> Routine, RoutineCall
move_4 = Move(
    Type=movement_type_3,
    Target=robot_joint_position,
    SpeedData=speed,
    ZoneData=zone_3,
    Override_Robot_Tool=False,
    Override_Work_Object=False,
    Set_Circular_Point=False,
    Set_Digital_Output=False,
    Set_Movement_Time=False)
robot_preset = RobotPreset(PositionPlane=xy_plane_2, Robot_Preset_Number=4)
rapid_generator = RAPIDGenerator(
    Robot=robot_preset,
    Actions=flatten([move_4, routine_call.RoutineCall]),
    AdditionalRoutines=routine.Routine,
    Add_loaddata=False,
    Add_tooldata=False,
    Add_wobjdata=False,
    Additional_Routines=True,
    Author=False,
    Enforce_Axis_Limits=False,
    Error_Handling=False,
    Is_System_Module=False,
    Main_Module=False,
    Module_Name=False,
    Output_loaddata=False,
    Output_tooldata=False,
    Output_wobjdata=False,
    Routine_Name=False,
    Routine_Scope=False)
rapid_module = Panel(rapid_generator)
